# Grasshopper definition 01_Variables.gh (Grasshopper 0.9.76)

c_script = CSharpScript()  # -> out, A, B, C, D
# ---------- c_script: C# ----------
    int integerNumber = 10;
    double doubleNumber = 12.5;
    bool boolValue = true;
    String message = "Hey Grasshopper!";


    A = integerNumber;
    B = doubleNumber;
    C = boolValue;
    D = message;
# ---------- end c_script ----------
integer = Panel(c_script.A)
double = Panel(c_script.B)
boolean = Panel(c_script.C)
string = Panel(c_script.D)
# C# Intro
# - codes by Tommaso Casucci 2017 -
# Attribution-ShareAlike 4.0 International (CC BY-SA 4.0)
# variables
panel = Panel(c_script.out)
