# Grasshopper definition 02_ArraysAndLists.gh (Grasshopper 0.9.76)

# C# Intro
# - code by Tommaso Casucci 2017 -
# Attribution 4.0 International (CC BY 4.0)
# Arrays
c_script = CSharpScript()  # -> out, A, B
# ---------- c_script: C# ----------
    //Adapded version of:
    //Arrays(C# Programming guide)
    //"https://msdn.microsoft.com/en-gb/library/9b9dty7d.aspx"


    // DECLARE A SINGLE DIMENSIONAL ARRAY
    int[] array1 = new int[5];

    //SET THE ARRAY ELEMENT VALUES
    array1[0] = 10;
    array1[1] = 7;
    array1[2] = 9;
    array1[3] = 12;
    array1[4] = 25;

    //RETRIVE THE i ELEMENT OF AN ARRAY
    int value_A = array1[1];
    A = value_A;


    //MEASURE THE LENGTH OF AN ARRAY
    B = array1.Length;

    // DECLARE AND SET ARRAY ELEMENT VALUES
    int[] array2 = new int[] { 1, 3, 5, 7, 9 };

    // ALTERNATIVE SYNTAX
    int[] array3 = { 1, 2, 3, 4, 5, 6 };

    // DECLARE A TWO DIMENSIONAL ARRAY
    int[,] multiDimensionalArray1 = new int[2, 3];

    // DECLARE AND SET ARRAY ELEMENT VALUES
    int[,] multiDimensionalArray2 = { { 1, 2, 3 }, { 4, 5, 6 } };
# ---------- end c_script ----------
# Lists
c_script_2 = CSharpScript()  # -> out, A, B, C
# ---------- c_script_2: C# ----------
    //CREATE THE LIST
    List<Point3d> listName = new List<Point3d>();


    //ADD ELEMENTS TO THE LIST

    Point3d pt_00 = new Point3d(0.0, 0.0, 0.0);
    listName.Add(pt_00);

    Point3d pt_01 = new Point3d(1.0, 0.0, 0.0);
    listName.Add(pt_01);

    Point3d pt_02 = new Point3d(2.0, 0.0, 0.0);
    listName.Add(pt_02);


    //COUNT THE ELEMENTS INSIDE THE LIST
    A = listName.Count();

    //OUTPUT THE LIST
    B = listName;

    //RETRIVE THE i ELEMENT OF A LIST
    Point3d ptOut = listName[0];
    C = ptOut;
# ---------- end c_script_2 ----------
i_element = Panel(c_script.A)
array_length = Panel(c_script.B)
panel = Panel(c_script.out)
panel_2 = Panel(c_script_2.out)
list_length = Panel(c_script_2.A)
list_elements = Panel(c_script_2.B)
i_element_2 = Panel(c_script_2.C)
