# Grasshopper definition 07_L-systems.gh (Grasshopper 0.9.76)

# C# Intro
# - code by Tommaso Casucci 2017 -
number_slider = Slider(0.12, range=0..1)
pi = Pi(Factor=Slider(0.11, range=0..1))
pi_2 = Pi(Factor=Slider(0.11, range=0.05..0.5))
pi_3 = Pi(Factor=number_slider)
c_script = CSharpScript(theta=pi_2, alpha=pi)  # -> out, A; inputs theta: Double, alpha: Double
# ---------- c_script: C# ----------
   
    //Adapted version of:
    //Trees by Daniel Shiffman
    //"http://natureofcode.com/book/chapter-8-fractals/"
    
    
    tree = new List<Line>();

    grow(new Plane(new Point3d(), new Vector3d(1.0, 0.0, 0.0)), 10.0, theta, alpha);

    A = tree;
# ---------- c_script: C# additional code ----------
  List<Line> tree ;

  void  grow (Plane _loc, double _len, double _angle01, double _angle02){

    //GENERATE NEW BRANCH
    Line branch = new Line(_loc.Origin, _loc.YAxis, _len);
    tree.Add(branch);
    double nextLength = _len * 0.87;

    if(nextLength > 2.0){

      //ROTATE LEFT
      Plane nextPlane = new Plane(_loc);

      nextPlane.Translate(_loc.YAxis * _len);
      nextPlane.Rotate(_angle01, _loc.ZAxis);
      nextPlane.Rotate(_angle02, _loc.YAxis);
      grow(nextPlane, nextLength, _angle01, _angle02);


      //ROTATE RIGHT
      nextPlane = new Plane(_loc);

      nextPlane.Translate(_loc.YAxis * _len);
      nextPlane.Rotate(-_angle01, _loc.ZAxis);
      nextPlane.Rotate(_angle02, _loc.YAxis);
      grow(nextPlane, nextLength, _angle01, _angle02);


    }


  }
# ---------- end c_script ----------
c_script_2 = CSharpScript(theta=pi_3)  # -> out, A; inputs theta: Double
# ---------- c_script_2: C# ----------
    //Adapted version of:
    //Trees by Daniel Shiffman
    //"http://natureofcode.com/book/chapter-8-fractals/"

    tree = new List<Line>();
    grow(new Point3d(), 10.0, new Vector3d(0.0, 1.0, 0.0), theta);
    A = tree;
# ---------- c_script_2: C# additional code ----------
  List<Line> tree ;

  void  grow (Point3d _seed, double _len, Vector3d _dir, double _angle){



    Line branch = new Line(_seed, _dir, _len);

    tree.Add(branch);

    double nextLength = _len * 0.85;

    if(nextLength > 2.0){

      // rotate left
      Vector3d nextDir = new Vector3d(branch.Direction);
      nextDir.Rotate(_angle, new Vector3d(0.0, 0.0, 1.0));
      grow(branch.PointAt(1.0), nextLength, nextDir, _angle);


      //  rotate right
      nextDir = new Vector3d(branch.Direction);
      nextDir.Rotate(-_angle, new Vector3d(0.0, 0.0, 1.0));
      grow(branch.PointAt(1.0), nextLength, nextDir, _angle);


    }


  }
# ---------- end c_script_2 ----------
panel = Panel(c_script.A)
# Attribution 4.0 International (CC BY 4.0)
debug = Panel(c_script_2.out)
debug_2 = Panel(c_script.out)
panel_2 = Panel(c_script_2.A)
preview = CustomPreview(Geometry=c_script.A, Shader=ColourSwatch(SwatchColor=RGB(61, 61, 61)))
preview_2 = CustomPreview(Geometry=c_script_2.A, Shader=ColourSwatch(SwatchColor=RGB(209, 209, 209)))
