# Grasshopper definition 08_Classes.gh (Grasshopper 0.9.76)

number_slider = Slider(25, range=0..100)  # disabled
reset = Button()
pop2d = Populate2D(Region={Plane=PlaneXY(0, 0, 0), Size=Domain2(u=0..20, v=0..10)}, Count=number_slider, Seed=1)  # disabled
pop2d_2 = Populate2D(Region={Plane=PlaneXY(0, 0, 0), Size=Domain2(u=0..20, v=0..10)}, Count=Slider(25, range=0..100), Seed=1)

# ---- group: Create Particle Class
# C# Intro
# - code by Tommaso Casucci 2017 -
# Attribution 4.0 International (CC BY 4.0)
c_script = CSharpScript()  # -> out, A; disabled
# ---------- c_script: C# ----------
    
    //Adapted version of:
    //Random Walks by Daniel Shiffman
    //"http://natureofcode.com/book/introduction/"
    
    
    
    //UPDATE myParticle
    myParticle.move();

    //EXPIRE GRASSHOPPER COMPONENT
    Component.ExpireSolution(true);

    //OUTPUTS
    A = myParticle.loc;
# ---------- c_script: C# additional code ----------
  //GLOBAL VARIABLES
  Particle myParticle = new Particle (new Point3d(0.0, 0.0, 0.0), 0);


  //CLASS
  class Particle {

    //FIELDS
    public Point3d loc;
    Random rand;

    //CONSTRUCTOR
    public Particle (Point3d _loc, int id){
      loc = _loc;
      rand = new Random(id);
    }

    //METHODS
    public void move(){
      Vector3d step = new Vector3d(rand.NextDouble() - 0.5, rand.NextDouble() - 0.5, 0.0);
      loc += step;
    }

  }
# ---------- end c_script ----------

# ---- group: add ParticleTrails
c_script_2 = CSharpScript(seeds=pop2d_2, run=Toggle(False), reset=reset)  # -> out, A, B; inputs seeds: list of Point3d, run: Boolean, reset: Boolean
# ---------- c_script_2: C# ----------
    //Adapted version of:
    //Random Walks by Daniel Shiffman
    //"http://natureofcode.com/book/introduction/"


    //INITIALIZE
    if (count == 0 || reset == true){

      particleCollection = new List<Particle>();
      locationCollection = new List<Point3d>();
      trailCollection = new List<Polyline>();


      for (int i = 0 ; i < seeds.Count; i++){
        Particle myParticle = new Particle(seeds[i], i);
        particleCollection.Add(myParticle);
        locationCollection.Add(myParticle.loc);
        trailCollection.Add(new Polyline(myParticle.trail));
      }
    }

    //UPDATE myParticle

    for (int i = 0 ; i < particleCollection.Count; i++){
      Particle myParticle = particleCollection[i];
      myParticle.move();
      locationCollection[i] = myParticle.loc;
      trailCollection[i] = new Polyline(myParticle.trail);
    }

    //UPDATE SOLUTION

    if(run)Component.ExpireSolution(true);

    count++;

    //OUTPUTS
    A = locationCollection;
    B = trailCollection;
# ---------- c_script_2: C# additional code ----------
  //GLOBAL VARIABLES

  List<Particle> particleCollection = new List<Particle>();
  List<Point3d> locationCollection = new List<Point3d>();
  List<Polyline> trailCollection = new List<Polyline>();

  int count = 0;

  //CLASS
  class Particle {

    //FIELDS
    public Point3d loc;
    Random rand;

    public List<Point3d> trail = new List<Point3d>();

    //CONSTRUCTOR
    public Particle (Point3d _loc, int id){
      loc = _loc;
      rand = new Random(id);
      trail.Add(new Point3d(loc));
    }

    //METHODS
    public void move(){
      Vector3d step = new Vector3d(rand.NextDouble() - 0.5, rand.NextDouble() - 0.5, 0.0);
      loc += step;
      trail.Add(new Point3d(loc));
    }

  }
# ---------- end c_script_2 ----------

# ---- group: Create multiple instance of thes Particle Class
c_script_3 = CSharpScript(seeds=pop2d)  # -> out, A; inputs seeds: list of Point3d; disabled
# ---------- c_script_3: C# ----------
    
    //Adapted version of:
    //Random Walks by Daniel Shiffman
    //"http://natureofcode.com/book/introduction/"

    
    //INITIALIZE
    if (count == 0){
      for (int i = 0 ; i < seeds.Count; i++){
        Particle myParticle = new Particle(seeds[i], i);
        particleCollection.Add(myParticle);
        locationCollection.Add(myParticle.loc);
      }
    }

    //UPDATE myParticle

    for (int i = 0 ; i < particleCollection.Count; i++){
      Particle myParticle = particleCollection[i];
      myParticle.move();
      locationCollection[i] = myParticle.loc;
    }

    //UPDATE SOLUTION
    Component.ExpireSolution(true);
    count++;

    //OUTPUTS
    A = locationCollection;
# ---------- c_script_3: C# additional code ----------
  //GLOBAL VARIABLES

  List<Particle> particleCollection = new List<Particle>();
  List<Point3d> locationCollection = new List<Point3d>();

  int count = 0;

  //CLASS
  class Particle {

    //FIELDS
    public Point3d loc;
    Random rand;

    //CONSTRUCTOR
    public Particle (Point3d _loc, int id){
      loc = _loc;
      rand = new Random(id);
    }

    //METHODS
    public void move(){
      Vector3d step = new Vector3d(rand.NextDouble() - 0.5, rand.NextDouble() - 0.5, 0.0);
      loc += step;
    }

  }
# ---------- end c_script_3 ----------

# ----
panel = Panel(c_script.out)  # disabled
cir = Circle(Plane=c_script.A, Radius=1)  # disabled
cir_2 = Circle(Plane=c_script_3.A, Radius=1)  # disabled
panel_2 = Panel(c_script_3.out)  # disabled
panel_3 = Panel(c_script_2.out)
cir_3 = Circle(Plane=c_script_2.A, Radius=1)
crv = Curve(c_script_2.B)
preview = CustomPreview(Geometry=cir_3, Shader=ColourSwatch(SwatchColor=RGB(0, 255, 191)))
preview_2 = CustomPreview(Geometry=crv, Shader=ColourSwatch(SwatchColor=RGB(97, 97, 97)))
