# Grasshopper definition 09_GradientDescent_Surfaces.gh (Grasshopper 0.9.76)

# C# Intro
# - code by Tommaso Casucci 2017 -
srf = Surface(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)
srf_2 = Surface(srf)
c_script = CSharpScript(surf=srf_2, reset=Button(), run=Toggle(True))  # -> out, A; inputs surf: Surface, reset: Boolean, run: Boolean
# ---------- c_script: C# ----------
        
    //Adapted version of:
    //Rhino Grasshopper Visual Basic Workshop by Woo Jae
    //"https://woojsung.com/2011/11/24/vb-workshop-harvard-gsd/"
    
    
    if (reset){
      count = 0;
    }


    if (count == 0 ){
      _surf = surf;
      _surf.SetDomain(0, new Interval(0.0, 1.0));
      _surf.SetDomain(1, new Interval(0.0, 1.0));

      partCollection = new List<Particle>();
      polyCollection = new List<Polyline>();

      for(int i = 0 ; i < partNum ; i++){


        Particle myParticle = new Particle(rand.NextDouble(), rand.NextDouble());
        partCollection.Add(myParticle);
        polyCollection.Add(myParticle.trail);
      }

    }



    count++;

    if(count < 75){
      for(int i = 0 ; i < partCollection.Count; i++){

        Particle myParty = partCollection[i];
        myParty.update();
        polyCollection[i] = myParty.trail;


      }
    }




    A = polyCollection;

    if(run){
      Component.ExpireSolution(true);
    }
# ---------- c_script: C# additional code ----------
  int count = 0;
  static Surface _surf;


  int partNum = 125;

  List<Particle> partCollection ;
  List<Polyline> polyCollection ;

  Random rand = new Random();

  class Particle{

    public Point3d loc;
    double u, v;
    double step = 0.25;

    public Polyline trail = new Polyline();

    public Particle (double _u, double _v){

      loc = _surf.PointAt(_u, _v);
      u = _u;
      v = _v;


      trail.Add(loc);
    }


    public void update(){

      Vector3d norm = _surf.NormalAt(u, v);
      Vector3d cross = Vector3d.CrossProduct(norm, new Vector3d(0.0, 0.0, 1.0));
      cross.Rotate(Math.PI * 0.5, norm);

      cross.Unitize();
      cross *= step;
      Point3d nextPos = Point3d.Add(loc, cross);

      _surf.ClosestPoint(nextPos, out u, out v);
      loc = _surf.PointAt(u, v);

      trail.Add(loc);

    }

  }
# ---------- end c_script ----------
# Attribution 4.0 International (CC BY 4.0)
c_script_2 = CSharpScript(surf=srf, reset=Button(), run=Toggle(False))  # -> out, A; inputs surf: Surface, reset: Boolean, run: Boolean
# ---------- c_script_2: C# ----------
    
    //Adapted version of:
    //Rhino Grasshopper Visual Basic Workshop by Woo Jae
    //"https://woojsung.com/2011/11/24/vb-workshop-harvard-gsd/"
    
    
    if (reset){
      count = 0;
    }


    if (count == 0 ){
      _surf = surf;
      _surf.SetDomain(0, new Interval(0.0, 1.0));
      _surf.SetDomain(1, new Interval(0.0, 1.0));
      myParticle = new Particle(0.25, 0.25);
    }



    count++;

    if(count < 50){
      myParticle.update();
    }

    A = myParticle.trail;

    if(run){
      Component.ExpireSolution(true);
    }
# ---------- c_script_2: C# additional code ----------
  int count = 0;
  static Surface _surf;
  Particle  myParticle ;


  class Particle{

    public Point3d loc;
    double u, v;
    double step = 0.25;

    public Polyline trail = new Polyline();

    public Particle (double _u, double _v){

      loc = _surf.PointAt(_u, _v);
      u = _u;
      v = _v;


      trail.Add(loc);
    }


    public void update(){

      Vector3d norm = _surf.NormalAt(u, v);
      Vector3d cross = Vector3d.CrossProduct(norm, new Vector3d(0.0, 0.0, 1.0));
      cross.Rotate(Math.PI * 0.5, norm);

      cross.Unitize();
      cross *= step;
      Point3d nextPos = Point3d.Add(loc, cross);

      _surf.ClosestPoint(nextPos, out u, out v);
      loc = _surf.PointAt(u, v);

      trail.Add(loc);

    }

  }
# ---------- end c_script_2 ----------
panel = Panel(c_script.out)
panel_2 = Panel(c_script.A)
panel_3 = Panel(c_script_2.out)
panel_4 = Panel(c_script_2.A)
preview = CustomPreview(Geometry=c_script.A, Shader=ColourSwatch(SwatchColor=RGB(20, 245, 185)))
