# Grasshopper definition 00_IntroToC#.gh (Grasshopper 0.9.76)

# ---- group: inputs
# C# component anatomy
number_slider = Slider(12, range=0..100)
number_slider_2 = Slider(54, range=0..100)

# ----
c_script = CSharpScript(x=number_slider, y=number_slider_2)  # -> out, A, B; inputs x: Int32, y: Int32
# ---------- c_script: C# ----------
    A = x;
    B = y;
# ---------- end c_script ----------

# ---- group: outputs
panel = Panel(c_script.A)
panel_2 = Panel(c_script.B)

# ---- group: 'out' output
panel_3 = Panel(c_script.out)

# ----
# C# Intro
# - codes by Tommaso Casucci 2017 -
# Attribution-ShareAlike 4.0 International (CC BY-SA 4.0)
# C#
# RhinoCommon
# C# Programming Guide: https://msdn.microsoft.com/en-gb/library/67ef8sbd.aspx
# RhinoCommon SDK: http://developer.rhino3d.com/api/RhinoCommon/html/N_Rhino.htm
what_is_rhinocommon = Panel("http://developer.rhino3d.com/guides/rhinocommon/what-is-rhinocommon/")
