# Grasshopper definition 03_ControlFlowStructures.gh (Grasshopper 0.9.76)

# C# Intro
# - codes by Tommaso Casucci 2017 -
number_slider = Slider(3.2, range=-10..10)
# if statement
c_script = CSharpScript(x=number_slider)  # -> out, A, B; inputs x: Double
# ---------- c_script: C# ----------
    
    
    if( x > 0.0 ){
      A = new Point3d(x,0.0,0.0);
       
    }else{
      B = new Point3d(x,0.0,0.0);
      
    }
# ---------- end c_script ----------
rectangle = Rectangle(Plane=c_script.B, XSize=Domain(-1, 1), YSize=Domain(-2, 2), Radius=0)  # -> Rectangle, Length
# Attribution-ShareAlike 4.0 International (CC BY-SA 4.0)
panel = Panel(c_script.out)
cir = Circle(Plane=c_script.A, Radius=1)
radius_a = Slider(0.5, range=0..10)
radius_b = Slider(3.92, range=0..10)
count_x = Slider(14, range=0..100)
count_y = Slider(15, range=0..100)
radius = Slider(2.1, range=0..10)
count_y_2 = Slider(15, range=0..100)
step = Slider(2.99, range=0..10)
step_2 = Slider(2.99, range=0..10)
thres = Slider(16.16, range=0..50)
step_3 = Slider(2.72, range=0..10)
count_x_2 = Slider(14, range=0..100)
radius_2 = Slider(1.06, range=0..10)
# loops
count = Slider(20, range=0..100)
pt = Point(Point(10, 34, 0))

# ---- group: for loop
c_script_2 = CSharpScript(circlesCount=count, step=step_3, radius=radius_2)  # -> out, A; inputs circlesCount: Int32, step: Double, radius: Double
# ---------- c_script_2: C# ----------
    List<Circle> circleCollection = new List<Circle>();


    for(int i = 0; i < circlesCount; i++){

      Circle myCircle = new Circle(new Point3d(step * i, 0.0, 0.0), radius);
      circleCollection.Add(myCircle);
    }


    A = circleCollection;
# ---------- end c_script_2 ----------

# ---- group: nested loop
c_script_3 = CSharpScript(circlesCount_X=count_x_2, circlesCount_Y=count_y_2, step=step, radius=radius)  # -> out, A; inputs circlesCount_X: Int32, circlesCount_Y: Int32, step: Double, radius: Double
# ---------- c_script_3: C# ----------
    List<Circle> circleCollection = new List<Circle>();


    for(int i = 0; i < circlesCount_X; i++){
      for(int j = 0; j < circlesCount_Y; j++){
        Circle myCircle = new Circle(new Point3d(step * i, step * j, 0.0), radius);
        circleCollection.Add(myCircle);
      }
    }


    A = circleCollection;
# ---------- end c_script_3 ----------

# ---- group: Attractor
c_script_4 = CSharpScript(
    circlesCount_X=count_x,
    circlesCount_Y=count_y,
    step=step_2,
    attractor=pt,
    thres=thres,
    radius_A=radius_a,
    radius_B=radius_b)  # -> out, A; inputs circlesCount_X: Int32, circlesCount_Y: Int32, step: Double, attractor: Point3d, thres: Double, radius_A: Double, radius_B: Double
# ---------- c_script_4: C# ----------
    List<Circle> circleCollection = new List<Circle>();


    for(int i = 0; i < circlesCount_X; i++){
      for(int j = 0; j < circlesCount_Y; j++){
        Point3d pos = new Point3d(step * i, step * j, 0.0);

        if(pos.DistanceTo(attractor) > thres){
          Circle myCircle = new Circle(pos, radius_A);
          circleCollection.Add(myCircle);
        }else{
          Circle myCircle = new Circle(pos, radius_B);
          circleCollection.Add(myCircle);
        }
      }
    }


    A = circleCollection;
# ---------- end c_script_4 ----------

# ----
panel_2 = Panel(c_script_3.A)
panel_3 = Panel(c_script_2.A)
panel_4 = Panel(c_script_3.out)
panel_5 = Panel(c_script_2.out)
panel_6 = Panel(c_script_4.A)
panel_7 = Panel(c_script_4.out)
