# Grasshopper definition 04_Functions.gh (Grasshopper 0.9.76)

size = Slider(2.69, range=0..10)
radius = Slider(3.39, range=0..10)
# C# Intro
# - codes by Tommaso Casucci 2017 -
# Attribution-ShareAlike 4.0 International (CC BY-SA 4.0)
# functions
number_slider = Slider(0.25, range=0..2.5)
pt = Point(Point(-20, 13, 0))

# ---- group: function
c_script = CSharpScript(pt=pt, size=size, radius=radius)  # -> out, A; inputs pt: Point3d, size: Double, radius: Double
# ---------- c_script: C# ----------
    A = flower(pt, radius, size);
# ---------- c_script: C# additional code ----------
  List<Circle> flower(Point3d origin, double rad, double _size){
    List<Circle> myList = new List<Circle> ();
    Circle cr_01 = new Circle(origin + new Point3d(_size, 0.0, 0.0), rad);
    myList.Add(cr_01);

    Circle cr_02 = new Circle(origin + new Point3d(-_size, 0.0, 0.0), rad);
    myList.Add(cr_02);

    Circle cr_03 = new Circle(origin + new Point3d(0.0, _size, 0.0), rad);
    myList.Add(cr_03);

    Circle cr_04 = new Circle(origin + new Point3d(0.0, -_size, 0.0), rad);
    myList.Add(cr_04);


    return myList;
  }
# ---------- end c_script ----------

c_script_2 = CSharpScript(x=number_slider, y=Slider(1.52, range=0..2.5))  # -> out, A; inputs x: Double, y: Double
# ---------- c_script_2: C# ----------
    A = addition(x, y);
# ---------- c_script_2: C# additional code ----------
  double addition(double value_A, double value_B){

    double result = value_A + value_B;
    return result;
  }
# ---------- end c_script_2 ----------

# ----
panel = Panel(c_script_2.A)
panel_2 = Panel(c_script_2.out)
panel_3 = Panel(c_script.A)
panel_4 = Panel(c_script.out)
