# Grasshopper definition 05_TrigonometricFunctions.gh (Grasshopper 0.9.76)

# C# Intro
# - codes by Tommaso Casucci 2017 -
# Attribution-ShareAlike 4.0 International (CC BY-SA 4.0)
number_slider = Slider(3.13, range=0..10)

# ---- group: Point
c_script = CSharpScript(h=number_slider, time=Slider(8.23, range=0..25))  # -> out, A; inputs h: Double, time: Double
# ---------- c_script: C# ----------
    A = new Point3d(time, Math.Sin(time) * h, 0.0);
# ---------- end c_script ----------

# ---- group: Polyline
c_script_2 = CSharpScript(h=Slider(2.76, range=0..10), step=Slider(0.12, range=0..1), time=Slider(117, range=0..150))  # -> out, A; inputs h: Double, step: Double, time: Int32
# ---------- c_script_2: C# ----------
    List <Point3d> ptCollection = new List<Point3d>();

    for (int i = 0 ; i < time ; i++){
      Point3d pt = new Point3d(i * step, Math.Sin(i * step) * h, 0.0);
      ptCollection.Add(pt);
    }
    A = new Polyline(ptCollection);
# ---------- end c_script_2 ----------

# ----
panel = Panel(c_script.out)
panel_2 = Panel(c_script_2.out)
crv = Curve(c_script_2.A)
cpoly = ControlPolygon(Curve=crv)  # -> Polygon, Points
