# Grasshopper definition 07_GradientDescent_Curves.gh (Grasshopper 0.9.76)

# C# Intro
# - codes by Tommaso Casucci 2017 -
crv = Curve(reparameterize(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))
c_script = CSharpScript(crv=crv, reset=Button())  # -> out, A; inputs crv: Curve, reset: Boolean
# ---------- c_script: C# ----------
    if(reset){
      t = 0.5;
    }

    iterate(crv);

    A = crv.PointAt(t);
    Component.ExpireSolution(true);
# ---------- c_script: C# additional code ----------
  //VARIABLES
  double t = 0.5;
  double step = 0.01;


  //GRADIENT DESCENT FUNCTION
  void iterate (Curve _crv){

    double t_old = t;

    if(_crv.PointAt(t_old + step).Y < _crv.PointAt(t_old).Y){
      if (t_old + step < 1.0)t = t_old + step;
    }

    if(_crv.PointAt(t_old - step).Y < _crv.PointAt(t_old).Y){
      if (t_old - step > 0.0)t = t_old - step;
    }

  }
# ---------- end c_script ----------
# Attribution-ShareAlike 4.0 International (CC BY-SA 4.0)
panel = Panel(c_script.out)
panel_2 = Panel(c_script.A)
